# Grasshopper definition UnityGH.gh (Grasshopper 1.0.7)
# plug-ins: gHowl, LunchBox

# ---- group: サーフェスのモデル化
number_slider = Slider(100, range=0..100)
maxhight = Slider(54, range=0..100)
number_slider_2 = Slider(758, range=0..1000)
number_slider_3 = Slider(5, range=0..10)
number_slider_4 = Slider(5, range=0..10)

planesrf = PlaneSurface(Plane=PlaneXY(0, 0, 0), XSize=number_slider, YSize=number_slider)
int = Integer(number_slider_3)
number_slider_5 = Slider(1, range=0..1)
int_2 = Integer(number_slider_4)
srf = Surface(reparameterize(planesrf))
sdivide = DivideSurface(Surface=srf, UCount=number_slider_3, VCount=number_slider_4)  # -> Points, Normals, simplify(Parameters)
addition = Addition(A=int, B=number_slider_5)
addition_2 = Addition(A=int_2, B=number_slider_5)
multiplication = Multiplication(A=addition, B=addition_2)
random = Random(Range=maxhight, Number=multiplication, Seed=number_slider_2)
unflatten = UnflattenTree(Tree=random, Guide=sdivide.Parameters)
Z = UnitZ(Factor=unflatten)
move = Move(Geometry=sdivide.Points, Motion=Z)  # -> simplify(Geometry), Transform
flatten = FlattenTree(Tree=move.Geometry, Path="{0}")
graft = GraftTree(Tree=flatten, IncludeEmptyLists=True, IncludeNullItems=True)
num = Number(Slider(15, range=0..100))
dist = Distance(PointA=graft, PointB=flatten)
smaller = SmallerThan(FirstNumber=dist, SecondNumber=num)  # -> SmallerThan, OrEqualTo
cull = CullPattern(List=dist, CullPattern=smaller.OrEqualTo)
dom = ConstructDomain(DomainStart="1", DomainEnd="0")
remap = RemapNumbers(Value=cull, Source=num, Target=dom)  # -> Mapped, Clipped
sqr = Square(Value=remap.Mapped)
pdecon = Deconstruct(Point=flatten)  # -> XComponent, YComponent, ZComponent
cull_2 = CullPattern(List=pdecon.ZComponent, CullPattern=smaller.OrEqualTo)
multiplication_2 = Multiplication(A=sqr, B=cull_2)
avr = Average(Input=multiplication_2)
flatten_2 = FlattenTree(Tree=avr, Path="{0}")
pt = ConstructPoint(XCoordinate=pdecon.XComponent, YCoordinate=pdecon.YComponent, ZCoordinate=flatten_2)
srfgrid = SurfaceFromPoints(Points=pt, UCount=addition_2, Interpolate=False)

# ---- group: UDP用のデータ整理
number_slider_6 = Slider(18, range=0..18)
tria = TriangularPanelsA(Surface=srfgrid, UDivisions=number_slider_6, VDivisions=number_slider_6)
debrep = DeconstructBrep(Brep=tria)  # -> Faces, Edges, flatten(Vertices)
fragment = TextFragment(Text=debrep.Vertices, Start=Slider(0, range=0..1))
netsource = NetworkSource()  # -> NetworkAdapterIsUp, AdapterProperties, LocalIpAddress
join = TextJoin(Text=fragment)
udp = UDPSender(Address=netsource.LocalIpAddress, Port=Slider(3333, range=0..10000), Pattern=0, Data=join)
panel = Panel(udp)
